% Simulink data dictionary VFD_DataDictionary.sldd

VFD_FAULT = VFD_States.VFD_FAULT
VFD_MAINS_OFF = VFD_States.VFD_MAINS_OFF
VFD_NOT_READY_TO_SWITCH_ON = VFD_States.VFD_NOT_READY_TO_SWITCH_ON
VFD_OFF1_ACTIVE = VFD_States.VFD_OFF1_ACTIVE
VFD_OFF2_ACTIVE = VFD_States.VFD_OFF2_ACTIVE
VFD_OFF3_ACTIVE = VFD_States.VFD_OFF3_ACTIVE
VFD_OPERATING = VFD_States.VFD_OPERATING
VFD_OPERATION_ENABLED = VFD_States.VFD_OPERATION_ENABLED
VFD_OPERATION_INHIBITED = VFD_States.VFD_OPERATION_INHIBITED
VFD_READY_TO_OPERATE = VFD_States.VFD_READY_TO_OPERATE
VFD_READY_TO_SWITCH_ON = VFD_States.VFD_READY_TO_SWITCH_ON
VFD_RFG_ACCELERATOR_ENABLED = VFD_States.VFD_RFG_ACCELERATOR_ENABLED
VFD_RFG_OUTPUT_ENABLED = VFD_States.VFD_RFG_OUTPUT_ENABLED
VFD_SWITCH_ON_INHIBITED = VFD_States.VFD_SWITCH_ON_INHIBITED